# Grasshopper definition solar_path_main.gh (Grasshopper 1.0.7)

minutes = Slider(0, range=0..60)
C = Count(13)
division = Division(A=minutes, B=60)
pi = Pi(Factor=1)
series = Series(Start=-90, Step=15, Count=C)
rad = Radians(Degrees=series)
list = ValueList({"Equinox": 0, "Summer Solstice": 23.45, "Winter Solstice": -23.45}, selected="Equinox")
rad_2 = Radians(Degrees=list)
number_slider = Slider(41, range=0..100)
c_script = CSharpScript(x=series)  # -> out, A; inputs x: Double
# ---------- c_script: C# ----------
    A = x * (Math.PI / 180);
# ---------- end c_script ----------
c_script_2 = CSharpScript(x=list)  # -> out, A; inputs x: Double; same code as c_script
c_script_3 = CSharpScript(x=Slider(55, range=0..90))  # -> out, A; inputs x: Double; same code as c_script
series_2 = Series(Start=0, Step=1, Count=10)
c_script_4 = CSharpScript(r=number_slider, HRA=c_script.A, LAT=c_script_3.A, DEC=c_script_2.A)  # -> out, rs, ds, ALT_values, dt, dh, rh; inputs r: Double, HRA: Double, LAT: Double, DEC: Double
# ---------- c_script_4: C# ----------
    /*Convert to degrees*/
    double cdg = (180 / Math.PI);


    double ALT = (Math.Asin((Math.Sin(DEC) * Math.Sin(LAT)) + (Math.Cos(DEC) * Math.Cos(LAT) * Math.Cos(HRA))));

    List<double> ALT_list = new List<double>();
    ALT_list.Add(ALT);

    List<double> ALT_list_corrected = new List<double>();
    foreach (double i in ALT_list)
    {
      ALT_list_corrected.Add(i * 1);
    }

    rs = r * Math.Cos(DEC) / (Math.Sin(ALT) + Math.Sin(DEC));
    ds = r * Math.Cos(LAT) / (Math.Sin(LAT) + Math.Sin(DEC));
    ALT_values = ALT_list_corrected[0];
    dt = r * (Math.Tan(LAT));
    dh = r / (Math.Cos(LAT)) * Math.Tan(HRA);
    rh = r / (Math.Cos(LAT)) * Math.Sin(HRA);
# ---------- end c_script_4 ----------
c_script_5 = CSharpScript(x=Slider(360, range=0..360))  # -> out, A; inputs x: Double
# ---------- c_script_5: C# ----------
    double cdg = Math.PI / 180;
    A = Math.Cos(x * cdg);
# ---------- end c_script_5 ----------
cir = Circle(Plane=PlaneXY(0, 0, 0), Radius=number_slider)
cp = ControlPoints(Curve=cir)  # -> Points, Weights, Knots
item = ListItem(List=c_script_4.dt, Index=0, Wrap=True)
item_2 = ListItem(List=c_script_4.ds, Index=0, Wrap=True)
panel = Panel(c_script_4.ds)
darc = DeconstructArc(Arc=cir)  # -> BasePlane, Radius, Angle
item_3 = ListItem(List=cp.Points, Index=4, Wrap=True)
item_4 = ListItem(List=cp.Points, Index=8, Wrap=True)
panel_2 = Panel(c_script_4.rs)
neg = Negative(Value=item_2)
ln = Line(StartPoint=item_3, EndPoint=item_4)
ext = ExtendCurve(Curve=ln, Type=0, Start=item_2, End=item_2)
pt = ConstructPoint(XCoordinate=darc.BasePlane, YCoordinate=neg, ZCoordinate=0)
Y = UnitY(Factor=item)
move = Move(Geometry=ext, Motion=Y)  # -> Geometry, Transform
circle = CircleCNR(Center=pt, Normal=Vector(0, 0, 1), Radius=c_script_4.rs)
vdisex = VectorDisplayEx(Colour=RGB(0, 0, 0), Width=2)
trim = TrimWithRegion(Curve=circle, Region=cir)  # -> Inside, Outside
item_5 = ListItem(List=trim.Inside, Index=0, Wrap=True)
