# Grasshopper definition solar_path_reset.gh (Grasshopper 1.0.7)

series = Series(Start=-23.5, Step=23.5, Count=3)
number_slider = Slider(100, range=0..100)
P = Plane(PlaneXY(0, 0, 0))
c_script = CSharpScript(r=number_slider, LAT=Slider(-28, range=-90..90), DEC=series)  # -> out, dh, ds, dt, rh, rs, hours; inputs r: Double, LAT: Double, DEC: list of Double
# ---------- c_script: C# ----------
    //Convert degree input to radians
    double cdr = (Math.PI / 180);


    //Create ALT list, add ALT values
    List<double> ALT = new List<double>();
    ALT.Add(90 - LAT - 23.45);
    ALT.Add(90);
    ALT.Add(90 - LAT + 23.45);

    //Create rs values
    double rs1 = (r * Math.Cos(DEC[0] * cdr)) / (Math.Sin(LAT * cdr) + Math.Sin(DEC[0] * cdr));
    double rs2 = (r * Math.Cos(DEC[1] * cdr)) / (Math.Sin(LAT * cdr) + Math.Sin(DEC[1] * cdr));
    double rs3 = (r * Math.Cos(DEC[2] * cdr)) / (Math.Sin(LAT * cdr) + Math.Sin(DEC[2] * cdr));
    //Add values to rs list
    List<double> rs_input = new List<double>();
    rs_input.Add(rs1);
    rs_input.Add(rs2);
    rs_input.Add(rs3);

    //Create ds values
    double ds1 = (r * (Math.Cos(LAT * cdr))) / (Math.Sin(LAT * cdr) + Math.Sin(DEC[0] * cdr));
    double ds2 = (r * Math.Cos(LAT * cdr)) / (Math.Sin(LAT * cdr) + Math.Sin(DEC[1] * cdr));
    double ds3 = (r * (Math.Cos(LAT * cdr))) / (Math.Sin(LAT * cdr) + Math.Sin(DEC[2] * cdr));
    //Add values to ds list
    List<double> ds_input = new List<double>();
    ds_input.Add(ds1);
    ds_input.Add(ds2);
    ds_input.Add(ds3);


    //Create dt
    double dt_input = (r * Math.Tan(LAT * cdr));

    //Create HRA values
    List<int> HRA = new List<int>();
    int i = 15;
    for(i = -75; i <= 75; i += 15)
    {
      HRA.Add(i);
    }

    //Create dh
    List<double> dh_input = new List<double>();
    foreach (double hour in HRA)
    {
      {
        double dh_values = r / (Math.Cos(LAT * cdr) * Math.Tan(hour * cdr));
        dh_input.Add(dh_values);
      }
    }

    dh_input.Remove(double.PositiveInfinity);
    dh_input.Add(0);
    dh_input.Sort();

    //Create rh
    List<double> rh_input = new List<double>();
    foreach (double hour in HRA)
    {
      double rh_values = r * ((Math.Cos(LAT * cdr)) * (Math.Sin(hour * cdr)));
      rh_input.Add(rh_values);
    }

    rh_input.Remove(double.PositiveInfinity);
    rh_input.Add(0);
    rh_input.Sort();


    ds = ds_input;
    rs = rs_input;
    dh = dh_input;
    rh = rh_input;
    dt = dt_input;
    hours = HRA;
# ---------- end c_script ----------
c_script_2 = CSharpScript(x=c_script.hours)  # -> out, A; inputs x: Double
# ---------- c_script_2: C# ----------
    A = 100 / (Math.Cos(-28 * (Math.PI/180)) * Math.Tan(x * (Math.PI/180)));
# ---------- end c_script_2 ----------
cir = Circle(Plane=P, Radius=number_slider)
panel = Panel(c_script.dh)
pt = ConstructPoint(XCoordinate=c_script.rh, YCoordinate=0, ZCoordinate=0)
panel_2 = Panel(c_script.rh)
Y = UnitY(Factor=c_script.ds)
circle = CircleCNR(Center=P, Normal=Vector(0, 0, 1), Radius=c_script.rs)
Y_2 = UnitY(Factor=c_script.dt)
move = Move(Geometry=circle, Motion=Y)  # -> Geometry, Transform
move_2 = Move(Geometry=pt, Motion=Y_2)  # -> Geometry, Transform
circle_2 = CircleCNR(Normal=Vector(0, 0, 1), Radius=1)
clean = CleanTree(RemoveNulls=True, RemoveInvalid=True, RemoveEmpty=False, Tree=circle_2)
split = SplitList(List=clean, Index=5)  # -> ListA, ListB
split_2 = SplitList(Index=12)  # -> ListA, ListB
darc = DeconstructArc(Arc=split.ListA)  # -> BasePlane, Radius, Angle
X = UnitX(Factor=split_2.ListA)
rev = ReverseList(List=darc.Radius)
neg = Negative(Value=darc.Radius)
split_3 = SplitList(Index=6)  # -> ListA, ListB
X_2 = UnitX(Factor=rev)
X_3 = UnitX(Factor=darc.Radius)
move_3 = Move(Geometry=split_3.ListA, Motion=neg)  # -> Geometry, Transform
rev_2 = ReverseList(List=X_3)
move_4 = Move(Geometry=split_3.ListB, Motion=X)  # -> Geometry, Transform
move_5 = Move(Motion=X_2)  # -> Geometry, Transform
move_6 = Move(Geometry=split.ListA, Motion=X_3)  # -> Geometry, Transform
